vi "802.11 Host.gvi"   [LabVIEW Communications System Design Suite 2.0.1]
# Queues pseudorandom number data to send the queue at the specified packet rate. The node ensures that the average packet rate is met even if it is not called in a regular time interval.
panel controls:
  "Trigger TX": bool
  "Clear events": bool
  "Operation Mode": T2 = "RF Loopback"
  "Primary Subband": UFXP(2.0) = 1
  "Transmit IP Address": string = "127.0.0.1"
  "Transmit Port": u16 = 12346
  "Receive Port": u16 = 12345
  "Tab": i32
  "Power Level [dBm]": f64
  "TX Frequency [Hz]": f64 = 2437000000
  "Destination MAC Address": u8[6] = [71, 111, 75, 117, 109, 98]
  "Device MAC Address": u8[6] = [71, 111, 75, 117, 109, 97]
  "TX Port (USRP only)": enum{"TX1/RF 0", "TX1/RF 1"} = "TX1/RF 0"
  "RX Port (USRP only)": T3 = "RX2/RF 1"
  "AGC": bool = TRUE
  "Manual RX gain [dB]": f64 = 37.5
  "PN Data Packet Size": i32 = 1024
  "Subcarrier Format": i32 = "20 MHz (IEEE 802.11 a)"(0)
  "Stop": bool
  "RIO Device": string = "RIO0"
  "Station": bool
  "reset TX staistics": bool
  "reset RX staistics": bool
  "PN Packets per Second": u32 = 1000
  "Transmit ACK": bool = TRUE
  "Backoff": u16 = 4
  "All": bool
  "None": bool
  "Events to Track": T5
  "CCA Energy Detection Threshold [dBm]": FXP(10.3) = -72
  "MCS": UFXP(4.0) = 4
  "session": "802.11 Host Session.gtype"
  "Data Source Option": i32 = 1
  "Data Sink Options": i32
  "Data Source": enum{"UDP", "PN Data", "Manual", "Multi-stream"} = "PN Data"
  "Data Sink": enum{"Off", "UDP"} = "Off"
  "Reference Clock": string = "Internal"
  "USRP bandwidth": "USRP bandwidth.gtype" = "40 MHz"
  "PN Data Packet Size_1": i32 = 1024
  "PN Packets per Second_1": u32 = 1000
  "PN Data Packet Size_2": i32 = 1024
  "PN Packets per Second_2": u32 = 1000
  "PN Data Packet Size_3": i32 = 1024
  "PN Packets per Second_3": u32 = 1000
  "PN Data Packet Size_4": i32 = 1024
  "PN Packets per Second_4": u32 = 1000
  "PN Data Packet Size_5": i32 = 1024
  "PN Packets per Second_5": u32 = 1000
panel indicators:
  "Events": string
  "MAC TX Statistic": T1
  "Baseband Power": f64
  "Coerced LO frequency TX [Hz]": f64
  "Coerced LO frequency RX [Hz]": f64
  "Channel Estimation": cluster{"Element 1": i32[], "Element 2": f64[]}[]
  "TX Block Error Rate": f64
  "Coerced Power Level [dBm]": f64
  "RX Throughput": f64
  "Applied RX Gain [dB]": f64
  "RX Throughput [bits/s]": f64
  "Current TX Block Error Rate (BLER)": f64
  "RX Frequency [Hz]": f64
  "Overwritten by Device MAC Address": bool
  "Station Active": bool
  "Device Ready": bool
  "Baseband RX Power [dBFS]": f64
  "RX Constellation": c128[]
  "RX Power Spectrum": T4
  "TX Power Spectrum": T4
  "Data Transfer": bool
  "FIFO Full": bool
  "FIFO Full": bool
  "Data Transfer": bool
  "Compensated CFO [Hz]": f64
  "TX Data Dropped": bool
  "modulation and coding rate": string
  "MAC RX Statistic": T10
  "Target FIFO Overflow": bool
  "RF Input Power": f64[][]
types:
  T1 = cluster{"TX after SIFS Requests Detected": u32, "TX after SIFS Requests Completed": u32, "TX after Backoff Requests Detected": u32, "TX after Backoff Requests Completed": u32}
  T2 = enum{"Baseband Loopback", "RF Loopback", "RF Multi Station"}
  T3 = enum{"RX1/RF 0", "RX2/RF 0", "RX1/RF 1", "RX2/RF 1"}
  T4 = cluster{"f0": f64, "df": f64, "magnitude": f64[]}
  T5 = cluster{"PhyTxStart": bool, "PhyTxEnd": bool, "PhyRxStart": bool, "PhyRxEnd": bool, "MacChannelState": bool, "MacTxStatus": bool, "PhyCcaTiming": bool, "PhyCcaTiming_2": bool, "PhyCcaTiming_3": bool}
  T6 = cluster{"Timestamp": u32, "Transferred Bytes": u32}
  T7 = cluster{"fpga ref": any, "bus instance": u32, "instruction FIFO depth": u32, "executing on FPGA target": bool, "show error call chain": bool}
  T8 = cluster{"Actual Gain [dB]": f64, "Attenuation Table Index": i32}
  T9 = cluster{"Attenuation Table [dB]": f64[][], "Frequencies [Hz]": f64[], "IQ Imbalance Table": "niUsrpRio Config v1 Host.lvlib__IQ Imbalance.gtype"[], "Gain Table": T8[][]}
  "niInstr Register Bus v0 Host.lvlib__Register Bus Session.gtype" = Queue<"niInstr Register Bus v0 Host.lvlib__Session Data.gtype">
  "Semaphore RefNum.gtype" = i32
  "niUsrpRio Config v1 Host.lvlib__DB Queue Reference.gtype" = Queue<"niUsrpRio Config v1 Host.lvlib__Daughterboard Data.gtype">
  "niUsrpRio Config v1 Host.lvlib__niUsrpRio Session.gtype" = cluster{"FPGA Interface": any, "RIO Interface Number": u32, "Data Clock Rate": u32, "FPGA Data Clock Rate": u32, "Global Settings Register Bus": "niInstr Register Bus v0 Host.lvlib__Register Bus Session.gtype", "Radio 0 Settings Register Bus": "niInstr Register Bus v0 Host.lvlib__Register Bus Session.gtype", "Radio 1 Settings Register Bus": "niInstr Register Bus v0 Host.lvlib__Register Bus Session.gtype", "Radio Settings Bus Semaphore": "Semaphore RefNum.gtype", "DB Queues": "niUsrpRio Config v1 Host.lvlib__DB Queue Reference.gtype"[], "Characterization Data Valid?": bool, "EEPROM Header": "niUsrpRio Config v1 Host.lvlib__EEPROM Header.gtype", "Device Data Header": "niUsrpRio Config v1 Host.lvlib__EEPROM Device Data Header.gtype", "EEPROM Characterization Header": "niUsrpRio Config v1 Host.lvlib__EEPROM Characterization Header.gtype", "Characterization Data": "niUsrpRio Config v1 Host.lvlib__Characterization Data.gtype"[], "FPGA Current Version": u32, "FPGA Oldest Compatible Version": u32, "Fixed Logic Current Version": u32, "Fixed Logic Oldest Compatible Version": u32, "FPGA Radio Settings Bus Current Version": u32, "FPGA Radio Settings Bus Oldest Compatible Version": u32, "FPGA Board Config Current Version": u32, "FPGA Board Config Oldest Compatible Version": u32, "Daughterboard Clock Rate": u32}
  "802.11 Host Session.gtype" = cluster{"FPGA interface": "802.11 FGPA Reference.gtype", "send queue": Queue<u8[]>, "receive queue": Queue<u8[]>, "receive throughput queue": Queue<T6>, "UDP Receiver": UdpNetworkConnectionRefnum, "PN packet": u8[], "FlexRIO session": Queue<T7>, "FlexRIO TX Characterization Data": T9, "FlexRIO RX Characterization Data": T9, "USRP session": "niUsrpRio Config v1 Host.lvlib__niUsrpRio Session.gtype", "RF loop clock frequency": f64}
  T10 = cluster{"Packet Starts detected": u32, "Frames from PHY": u32, "Frames with FCS pass": u32, "ACKs Received": u32}
  "USRP bandwidth.gtype" = enum{"40 MHz", "120 MHz", "160 MHz"}
  T11 = cluster{"TX after SIFS requests detected": u32, "TX after SIFS requests completed": u32, "TX after backoff requests detected": u32, "TX after backoff requests completed": u32}
  T12 = cluster{"Frames detected": u32, "Subframes received": u32, "Valid subframes received": u32, "ACKs received": u32}
  T13 = cluster{"PhyTxStart": bool, "PhyTxEnd": bool, "PhyRxStart": bool, "PhyRxEnd": bool, "MacChannelState": bool, "MacTxStatus": bool, "PhyCcaTiming": bool, "PhyRxGainChange": bool, "PhyRxAGCStateChange": bool}
  T14 = cluster{"remove header": bool, "block unsupported frame types": bool, "block FCS errors": bool, "block address mismatch": bool, "block header recognize error": bool}
diagram:
  sequence {
    frame 0 {
      $Events <- EmptyString
      $"Device Ready" <- FALSE
      $"Station Active" <- FALSE
      $Station <- FALSE
      $"RX Constellation" <- c128[] []
      $"RX Power Spectrum" <- T4 {all zero or empty}
      $"TX Power Spectrum" <- T4 {all zero or empty}
      $"Channel Estimation" <- cluster{"Element 1": i32[], "Element 2": f64[]}[] []
      $"MAC TX Statistic" <- T11 {all zero or empty}
      $"MAC RX Statistic" <- T12 {all zero or empty}
      $"Current TX Block Error Rate (BLER)" <- 0
      $"RX Throughput [bits/s]" <- 0
      $"Compensated CFO [Hz]" <- 0
      for (N = 51) {
        $"RX Throughput" <- NaN
        $"TX Block Error Rate" <- NaN
        $"Baseband Power" <- NaN
      }
      Initialize Array(element=NaN, size=51, size=2) -> w1
      $"RF Input Power" <- w1
    }
  }
  call "Create Stop Notifier.gvi"(error in=no error) -> (error out=w2)
  call "802.11 Host Init.gvi"(device=$"RIO Device", error in=w2, reference clock=$"Reference Clock", USRP bandwidth=$"USRP bandwidth") -> (session out=w3, error out=w4)
  case (w4) {
    frame Error {
      w5 = w4
    }
    frame No Error {
      $"Device Ready" <- TRUE
      $session <- w3
      w5 = w4
    }
  }
  s1 = w5  # shift register
  while {
    # RX Reception
    call "802.11 Unbundle Session.gvi"(session=$session) -> (FPGA interface=w6, receive queue=w7, receive throughput queue=w8)
    call "802.11 Receive RX ICP.gvi"(FPGA interface=w6, error in=s1, receive queue=w7, receive throughput queue=w8, enqueue decoded data=$"Station Active") -> (error out=w9)
    call "Check Stop.gvi"(error in=w9) -> (error out=w10, stop=w11)
    Wait Until Next Multiple(multiple to wait=0)
    next s1 = w10
    stop if w11
  }
  call "Stop On Error.gvi"(error in=s1) -> (error out=w12)
  s2 = w5  # shift register
  s3 = string[] []  # shift register
  while {
    call "802.11 Unbundle Session.gvi"(session=$session) -> (FPGA interface=w13)
    call "802.11 Prepare Constellation.gvi"(FPGA interface=w13, error in=s2, maximal number of subcarriers=4800) -> (error out=w14, data field constellation=w15, update constellation=w16)
    # update plots and indicators (slow)
    Logical And($"Station Active", w16) -> w17
    case (w17) {
      frame False { }
      frame True {
        $"RX Constellation" <- w15
      }
    }
    call "802.11 Read Event FIFO.gvi"(FPGA interface=w13, error in=s2) -> (raw events=w18, error out=w19)
    call "802.11 Prepare RX Power Spectrum.gvi"(FPGA interface=w13, error in=s2) -> (error out=w20, RX power spectrum=w21, update power spectrum=w22)
    call "802.11 Prepare TX Power Spectrum.gvi"(FPGA interface=w13, error in=s2) -> (error out=w23, TX power spectrum=w24, update power spectrum=w25)
    call "802.11 Prepare Channel Estimation.gvi"(FPGA interface=w13, error in=s2, channel subband=$"Primary Subband", subcarrier format=$"Subcarrier Format") -> (error out=w26, channel estimation=w27, update power spectrum=w28)
    call "802.11 Read Target Registers.gvi"(FPGA interface=w13, error in=s2) -> (error out=w29, target FIFO overflow=w30, compensated CFO=w31, RF input power=w32, MAC RX statistics=w33, MAC TX statistics=w34, signal power at packet start=w35)
    Merge Errors(w14, w20, w23, w26, w29, w19) -> (error out=w36)
    call "Check Stop.gvi"(error in=w36) -> (error out=w37, stop=w38)
    Logical And($"Station Active", w22) -> w39
    case (w39) {
      frame False, Default { }
      frame True {
        $"RX Power Spectrum" <- w21
      }
    }
    Logical And($"Station Active", w25) -> w40
    case (w40) {
      frame False, Default { }
      frame True {
        $"TX Power Spectrum" <- w24
      }
    }
    Logical And($"Station Active", w28) -> w41
    case (w41) {
      frame False, Default { }
      frame True {
        $"Channel Estimation" <- w27
      }
    }
    $"Target FIFO Overflow" <- w30
    $"Compensated CFO [Hz]" <- w31
    $"RF Input Power" <- w32
    $"Baseband Power" <- w35
    $"MAC RX Statistic" <- w33
    $"MAC TX Statistic" <- w34
    call "802.11 Events to String.gvi"(event data=w18, events to track=$"Events to Track") -> (event strings=w42)
    for {
      w43 = each element of w42
      Match Pattern(regular expression="PhyRxStart.ind ", string=w43) -> (offset past match=w45)
      Is Not Equal(x=w45, y=-1) -> w46
      append w46 to w44
    }
    Or Array Elements(Boolean array=w44)
    w47 = -12  # CFX data type offset
    Add(w35, w47) -> w48
    $"Baseband RX Power [dBFS]" <- w48
    Build Array[ConcatenateInputs=True](s3, w42) -> w49
    Delete From Array(inArray=w49, length (1)=10000) -> (deleted=w50)
    Select(s=$"Clear events", t=string[] [], f=w50) -> w51
    Concatenate Strings(w50) -> w52
    $Events <- w52
    Select(s=$None, t=T13 {all zero or empty}, f=$"Events to Track") -> w53
    w54 = T13 {"PhyTxStart"=TRUE, "PhyTxEnd"=TRUE, "PhyRxStart"=TRUE, "PhyRxEnd"=TRUE, "MacChannelState"=TRUE, "MacTxStatus"=TRUE, "PhyCcaTiming"=TRUE, "PhyRxGainChange"=TRUE, "PhyRxAGCStateChange"=TRUE}
    Select(s=$All, t=w54, f=w53) -> w55
    $"Events to Track" <- w55
    Wait Until Next Multiple(multiple to wait=250)
    next s2 = w37
    next s3 = w51
    stop if w38
  }
  call "Stop On Error.gvi"(error in=s2) -> (error out=w56)
  s4 = w5  # shift register
  while {
    Feedback Node(input=$"Station Active") -> w57
    Is Not Equal(x=$"Station Active", y=w57) -> w58
    # update plots and indicators (fast)
    case ($"Station Active") {
      frame False, Default {
        w59 = s4
      }
      frame True {
        call "802.11 Unbundle Session.gvi"(session=$session) -> (FPGA interface=w60, receive throughput queue=w61)
        call "802.11 Prepare Throughput Measurements.gvi"(reset=w58, FPGA interface=w60, receive throughput queue=w61, error in=s4, timing granularity=100) -> (error out=w59, TX block error rate=w62, RX throughput=w63)
        $"Current TX Block Error Rate (BLER)" <- w62
        $"TX Block Error Rate" <- w62
        $"RX Throughput [bits/s]" <- w63
        Divide(x=w63, y=1000000) -> w64
        $"RX Throughput" <- w64
      }
    }
    call "Check Stop.gvi"(error in=w59) -> (error out=w65, stop=w66)
    Wait Until Next Multiple(multiple to wait=100)
    next s4 = w65
    stop if w66
  }
  call "Stop On Error.gvi"(error in=s4) -> (error out=w67)
  Udp Open(error in=w5, net address=0, port=0, service name="", timeout ms=25000) -> (connection ID=w68, error out=w69)
  call "Set Socket Option.gvi"(connection in=w68, level=0xFFFF, option name=0x1001, value=1024000, error in=w69) -> (error out=w70, connection out=w71)
  s5 = w70  # shift register
  s6 = w71  # shift register
  while {
    call "802.11 Unbundle Session.gvi"(session=$session) -> (send queue_1=w72, send queue_5=w73, receive queue=w74, send queue_2=w75, UDP receiver=w76, PN packet=w77, send queue_3=w78, send queue_4=w79)
    # UDP send and receive
    case ($"Station Active") {
      frame False, Default {
        w80 = s5
        w81 = s6
      }
      frame True {
        Array Subset(array=w77, length0=$"PN Data Packet Size_1") -> w82
        Array Subset(array=w77, length0=$"PN Data Packet Size_2") -> w83
        Array Subset(array=w77, length0=$"PN Data Packet Size_3") -> w84
        Array Subset(array=w77, length0=$"PN Data Packet Size_4") -> w85
        Array Subset(array=w77, length0=$"PN Data Packet Size_5") -> w86
        Array Subset(array=w77, length0=$"PN Data Packet Size") -> w87
        case ($"Data Source") {
          frame "UDP" {
            # UDP
            call "802.11 Receive UDP Data.gvi"(UDP receiver=w76, send queue=w72, error in=s5) -> (data transfer=w89, error out=w88, FIFO full=w90)
            $"FIFO Full" <- w90
          }
          frame "PN Data" {
            # PN data
            call "802.11 Send PN Data.gvi"(PN packets per second=$"PN Packets per Second", send queue=w72, PN data=w87, error in=s5) -> (data transfer=w89, error out=w88)
          }
          frame "Manual", Default {
            # Manual
            case ($"Trigger TX") {
              frame False, Default {
                w88 = s5
                w89 = $"Trigger TX"
              }
              frame True {
                Enqueue Element(element=w87, error in=s5, queue=w72, timeout in ms=-1) -> (error out=w88, queue out=w91)
                w89 = $"Trigger TX"
              }
            }
          }
          frame "Multi-stream" {
            case ($"Data Source") {
              frame "UDP", Default {
                w88 = s5
                w89 = FALSE
              }
              frame "PN Data" {
                # PN data
                call "802.11 Send PN Data.gvi"(PN packets per second=$"PN Packets per Second_1", send queue=w72, PN data=w82, error in=s5) -> (data transfer=w89, error out=w88)
              }
            }
            case ($"Data Source") {
              frame "UDP", Default { }
              frame "PN Data" {
                # PN data
                call "802.11 Send PN Data.gvi"(PN packets per second=$"PN Packets per Second_2", send queue=w75, PN data=w83, error in=s5)
              }
            }
            case ($"Data Source") {
              frame "UDP", Default { }
              frame "PN Data" {
                # PN data
                call "802.11 Send PN Data.gvi"(PN packets per second=$"PN Packets per Second_3", send queue=w78, PN data=w84, error in=s5)
              }
            }
            case ($"Data Source") {
              frame "UDP", Default { }
              frame "PN Data" {
                # PN data
                call "802.11 Send PN Data.gvi"(PN packets per second=$"PN Packets per Second_4", send queue=w79, PN data=w85, error in=s5)
              }
            }
            case ($"Data Source") {
              frame "UDP", Default { }
              frame "PN Data" {
                # PN data
                call "802.11 Send PN Data.gvi"(PN packets per second=$"PN Packets per Second_5", send queue=w73, PN data=w86, error in=s5)
              }
            }
          }
        }
        $"Data Transfer" <- w89
        Is Equal(x=$"Data Sink", y="UDP") -> w92
        call "802.11 Send UDP Data.gvi"(target port=$"Transmit Port", target IP address=$"Transmit IP Address", receive queue=w74, UDP sender=s6, enable=w92, error in=s5) -> (FIFO full=w93, error out=w94, UDP sender dup=w81, data transfer=w95)
        $"Data Transfer" <- w95
        $"FIFO Full" <- w93
        Merge Errors(w88, w94) -> (error out=w80)
      }
    }
    call "Check Stop.gvi"(error in=w80) -> (error out=w96, stop=w97)
    Wait Until Next Multiple(multiple to wait=0)
    next s5 = w96
    next s6 = w81
    stop if w97
  }
  call "Stop On Error.gvi"(error in=s5) -> (error out=w98)
  Udp Close(connection ID=s6, error in=w98) -> (error out=w99)
  s7 = w5  # shift register
  while {
    Wait Until Next Multiple(multiple to wait=0)
    call "802.11 Unbundle Session.gvi"(session=$session) -> (FPGA interface=w100, send queue_1=w101, send queue_5=w102, send queue_2=w103, send queue_3=w104, send queue_4=w105)
    w106 = $"Device MAC Address"
    w107 = $"Operation Mode"
    w108 = $"Destination MAC Address"
    w109 = $"Subcarrier Format"
    # TX transmission
    w110 = $MCS
    w111 = $"Station Active"
    while {
      Dequeue Element(error in=s7, queue=w103, timeout in ms=0) -> (element=w112, error out=w113, timed out?=w114)
      Logical And(w111, not w114) -> w115
      case (w115) {
        frame False {
          w116 = w113
          w117 = default
          w118 = default
        }
        frame True {
          call "802.11 Subcarrier Format to Configuration.gvi"(MCS=w110, subcarrier format=w109, error in=w113) -> (error out=w119, format=w120, bandwidth=w121, valid configuration=w122)
          Is Not Equal(x=w107, y="RF Multi Station") -> w118
          Select(s=w118, t=w106, f=w108) -> w123
          case (w122) {
            frame False, Default {
              w117 = FALSE
              w116 = w119
            }
            frame True {
              call "802.11 Send TX ICP.gvi"(FPGA interface=w100, MCS=w110, device MAC address=w106, error in=w119, destination MAC address=w123, payload=w112, format=w120, bandwidth=w121) -> (dropped?=w117, error out=w116)
            }
          }
        }
      }
      call "Check Stop.gvi"(error in=w116) -> (error out=w124, stop=w125)
      Logical Or(w125, w114) -> w126
      stop if w126
    }
    while {
      Dequeue Element(error in=s7, queue=w104, timeout in ms=0) -> (element=w127, error out=w128, timed out?=w129)
      Logical And(w111, not w129) -> w130
      case (w130) {
        frame False {
          w131 = w128
          w132 = default
          w133 = default
        }
        frame True {
          call "802.11 Subcarrier Format to Configuration.gvi"(MCS=w110, subcarrier format=w109, error in=w128) -> (error out=w134, format=w135, bandwidth=w136, valid configuration=w137)
          Is Not Equal(x=w107, y="RF Multi Station") -> w133
          Select(s=w133, t=w106, f=w108) -> w138
          case (w137) {
            frame False, Default {
              w132 = FALSE
              w131 = w134
            }
            frame True {
              call "802.11 Send TX ICP.gvi"(FPGA interface=w100, MCS=w110, device MAC address=w106, error in=w134, destination MAC address=w138, payload=w127, format=w135, bandwidth=w136) -> (dropped?=w132, error out=w131)
            }
          }
        }
      }
      call "Check Stop.gvi"(error in=w131) -> (error out=w139, stop=w140)
      Logical Or(w140, w129) -> w141
      stop if w141
    }
    while {
      Dequeue Element(error in=s7, queue=w105, timeout in ms=0) -> (element=w142, error out=w143, timed out?=w144)
      Logical And(w111, not w144) -> w145
      case (w145) {
        frame False {
          w146 = w143
          w147 = default
          w148 = default
        }
        frame True {
          call "802.11 Subcarrier Format to Configuration.gvi"(MCS=w110, subcarrier format=w109, error in=w143) -> (error out=w149, format=w150, bandwidth=w151, valid configuration=w152)
          Is Not Equal(x=w107, y="RF Multi Station") -> w148
          Select(s=w148, t=w106, f=w108) -> w153
          case (w152) {
            frame False, Default {
              w147 = FALSE
              w146 = w149
            }
            frame True {
              call "802.11 Send TX ICP.gvi"(FPGA interface=w100, MCS=w110, device MAC address=w106, error in=w149, destination MAC address=w153, payload=w142, format=w150, bandwidth=w151) -> (dropped?=w147, error out=w146)
            }
          }
        }
      }
      call "Check Stop.gvi"(error in=w146) -> (error out=w154, stop=w155)
      Logical Or(w155, w144) -> w156
      stop if w156
    }
    while {
      Dequeue Element(error in=s7, queue=w102, timeout in ms=0) -> (element=w157, error out=w158, timed out?=w159)
      Logical And(w111, not w159) -> w160
      case (w160) {
        frame False {
          w161 = w158
          w162 = default
          w163 = default
        }
        frame True {
          call "802.11 Subcarrier Format to Configuration.gvi"(MCS=w110, subcarrier format=w109, error in=w158) -> (error out=w164, format=w165, bandwidth=w166, valid configuration=w167)
          Is Not Equal(x=w107, y="RF Multi Station") -> w163
          Select(s=w163, t=w106, f=w108) -> w168
          case (w167) {
            frame False, Default {
              w162 = FALSE
              w161 = w164
            }
            frame True {
              call "802.11 Send TX ICP.gvi"(FPGA interface=w100, MCS=w110, device MAC address=w106, error in=w164, destination MAC address=w168, payload=w157, format=w165, bandwidth=w166) -> (dropped?=w162, error out=w161)
            }
          }
        }
      }
      call "Check Stop.gvi"(error in=w161) -> (error out=w169, stop=w170)
      Logical Or(w170, w159) -> w171
      stop if w171
    }
    # 2017/08/18  Yue
    # need to point the write FIFO to RX
    while {
      Dequeue Element(error in=s7, queue=w101, timeout in ms=0) -> (element=w172, error out=w173, timed out?=w174)
      Logical And(w111, not w174) -> w175
      case (w175) {
        frame False {
          w176 = w173
          w177 = default
          w178 = default
        }
        frame True {
          call "802.11 Subcarrier Format to Configuration.gvi"(MCS=w110, subcarrier format=w109, error in=w173) -> (error out=w179, format=w180, bandwidth=w181, valid configuration=w182)
          Is Not Equal(x=w107, y="RF Multi Station") -> w178
          Select(s=w178, t=w106, f=w108) -> w183
          case (w182) {
            frame False, Default {
              w177 = FALSE
              w176 = w179
            }
            frame True {
              call "802.11 Send TX ICP.gvi"(FPGA interface=w100, MCS=w110, device MAC address=w106, error in=w179, destination MAC address=w183, payload=w172, format=w180, bandwidth=w181) -> (dropped?=w177, error out=w176)
            }
          }
        }
      }
      call "Check Stop.gvi"(error in=w176) -> (error out=w184, stop=w185)
      Logical Or(w185, w174) -> w186
      stop if w186
    }
    Merge Errors(w184, w124, w139, w154, w169) -> (error out=w187)
    call "Check Stop.gvi"(error in=w187) -> (error out=w188, stop=w189)
    Logical And(w177, w117, w132, w147, w162) -> w190
    $"TX Data Dropped" <- w190
    Logical And(w178, w118, w133, w148, w163) -> w191
    $"Overwritten by Device MAC Address" <- w191
    next s7 = w188
    stop if w189
  }
  call "Stop On Error.gvi"(error in=s7) -> (error out=w192)
  s8 = w5  # shift register
  while {
    # configuration
    call "802.11 Unbundle Session.gvi"(session=$session) -> (FPGA interface=w193)
    Feedback Node(input=$"Station Active") -> w194
    case ($"Station Active") {
      frame False, Default {
        w195 = s8
      }
      frame True {
        Is Not Equal(x=$"Station Active", y=w194) -> w196
        call "802.11 Gain Control.gvi"(initialize=w196, RX Port (USRP only)=$"RX Port (USRP only)", session=$session, AGC=$AGC, error in=s8, Manual RX gain [dB]=$"Manual RX gain [dB]", RX Frequency [Hz]=$"RX Frequency [Hz]", TX Port (USRP only)=$"TX Port (USRP only)") -> (Applied RX Gain [dB]=w197, error out=w198)
        $"Applied RX Gain [dB]" <- w197
        call "802.11 Subcarrier Format to Configuration.gvi"(MCS=$MCS, subcarrier format=$"Subcarrier Format", error in=s8) -> (error out=w199, format=w200)
        call "802.11 Configure Dynamic Parameters.gvi"(FPGA interface=w193, error in=w199, format=w200, transmit ACK=$"Transmit ACK", backoff value=$Backoff, CCA energy detection threshold=$"CCA Energy Detection Threshold [dBm]") -> (error out=w201)
        Merge Errors(w198, w201) -> (error out=w195)
      }
    }
    w202 = $Station
    Feedback Node(input=w202) -> w203
    Logical Exclusive Or(w202, w203) -> w204
    case (w204) {
      frame False, Default {
        w205 = s8
      }
      frame True {
        case (w202) {
          frame False, Default {
            sequence {
              frame 0 {
                $"Station Active" <- w202
              }
            }
            call "802.11 Unbundle Session.gvi"(session=$session) -> (UDP receiver=w206)
            Udp Close(connection ID=w206, error in=s8) -> (error out=w207)
            call "Clear Errors.gvi"(specific error code to clear=1, error in=w207) -> (error out=w208)
            call "802.11 Abort RF Streams.gvi"(session=$session, error in=w208) -> (error out=w205)
          }
          frame True {
            $"RX Frequency [Hz]" <- $"TX Frequency [Hz]"
            call "802.11 FPGA Target Configuration.gvi"() -> (maximum gain=w209, enable DC offset correction=w210)
            w211 = T14 {"remove header"=TRUE, "block unsupported frame types"=TRUE, "block FCS errors"=TRUE, "block address mismatch"=TRUE, "block header recognize error"=TRUE}
            call "802.11 Configure Static Parameters.gvi"(session in=$session, error in=s8, primary subband=$"Primary Subband", operation mode=$"Operation Mode", enable DC offset correction=w210, MPDU filter configuration=w211, device MAC address=$"Device MAC Address") -> (session dup=w212, error out=w213)
            call "802.11 Reset Statistics.gvi"(session in=w212, error in=w213, reset RX statistics=TRUE, reset TX statistics=TRUE) -> (error out=w214, session dup=w215)
            call "802.11 Configure TX RF.gvi"(TX port=$"TX Port (USRP only)", session=w215, TX frequency=$"TX Frequency [Hz]", TX power level=$"Power Level [dBm]", error in=w214) -> (session dup=w216, error out=w217, coerced TX power level=w218, coerced LO frequency=w219)
            call "802.11 Configure RX RF.gvi"(RX frequency=$"TX Frequency [Hz]", session=w216, RX gain=w209, error in=w217, RX port=$"RX Port (USRP only)") -> (error out=w220, session dup=w221, coerced RX gain=w222, coerced LO frequency=w223)
            call "802.11 Configure AGC Registers.gvi"(TX Port=$"TX Port (USRP only)", enable AGC=FALSE, session=w221, RX port=$"RX Port (USRP only)", error in=w220) -> (error out=w224, session dup=w225)
            call "802.11 Set Power Calibration Offset.gvi"(session=w225, frequency=$"TX Frequency [Hz]", error in=w224, RX port=$"RX Port (USRP only)") -> (session dup=w226, error out=w227)
            call "802.11 Configure RF Streams.gvi"(TX port=$"TX Port (USRP only)", RX port=$"RX Port (USRP only)", session=w226, error in=w227) -> (session dup=w228, error out=w229)
            call "802.11 Configure Data Source.gvi"(error in=w229, receive port=$"Receive Port", session in=w228) -> (error out=w205, session out=w230, success?=w231)
            $session <- w230
            sequence {
              frame 0 {
                $Station <- w231
                $"Station Active" <- w202
              }
            }
            $"Coerced LO frequency RX [Hz]" <- w223
            $"Applied RX Gain [dB]" <- w222
            $"Coerced LO frequency TX [Hz]" <- w219
            $"Coerced Power Level [dBm]" <- w218
          }
        }
      }
    }
    call "802.11 Reset Statistics.gvi"(session in=$session, error in=s8, reset RX statistics=$"reset RX staistics", reset TX statistics=$"reset TX staistics") -> (error out=w232)
    call "802.11 Subcarrier Format to Configuration.gvi"(MCS=$MCS, subcarrier format=$"Subcarrier Format", error in=w232) -> (modulation and coding rate=w233, error out=w234)
    Merge Errors(w195, w205, w234) -> (error out=w235)
    call "Create Stop.gvi"(error in=w235, stop in=$Stop) -> (error out=w236)
    call "Check Stop.gvi"(error in=w236) -> (error out=w237, stop=w238)
    Wait Until Next Multiple(multiple to wait=100)
    $"modulation and coding rate" <- w233
    next s8 = w237
    stop if w238
  }
  call "Stop On Error.gvi"(error in=s8) -> (error out=w239)
  Merge Errors(w239, w192, w12, w99, w56, w67) -> (error out=w240)
  sequence {
    frame 0 {
      w241 = $session
    }
  }
  call "802.11 Host Release.gvi"(session=w241, error in=w240) -> (error out=w242)
  call "Simple Error Handler.gvi"(type of dialog="OK message", error in=w242)
